# Grasshopper definition make line.gh (Grasshopper 1.0.8)

number_slider = Slider(6, range=0..100)
crv = Curve([<curve referenced from the Rhino model> x28])
srf = Surface(<surface referenced from the Rhino model>)
line = Line()
geo = Geometry()
cp = ControlPoints(Curve=crv)  # -> Points, Weights, Knots
sdivide = DivideSurface(Surface=srf, UCount=Slider(27, range=0..100), VCount=Slider(86, range=0..100))  # -> Points, Normals, Parameters
panel = Panel(cp.Points)
image = ImageSampler(
    sdivide.Parameters,
    FilePath="C:\Users\Ariga-GO\Desktop\images.jpg",
    Filter="Value",
    Interpolate=False,
    Umax=150,
    Umin=1,
    Vmax=150,
    Vmin=1,
    Wrap=1)
multiplication = Multiplication(A=image, B=Slider(10, range=0..10))
Z = UnitZ(Factor=multiplication)
move = Move(Geometry=sdivide.Points, Motion=Z)  # -> Geometry, Transform
shift = ShiftList(List=move.Geometry, Shift=1, Wrap=True)
ln = Line(StartPoint=move.Geometry, EndPoint=shift)
