# Grasshopper definition preview.gh (Grasshopper 1.0.8)

number_slider = Slider(30, range=0..100)
pt = ConstructPoint(XCoordinate=0, YCoordinate=0, ZCoordinate=0)
number_slider_2 = Slider(6, range=0..100)
number_slider_3 = Slider(140, range=0..1000)
srf = Surface(<surface referenced from the Rhino model>)
sdivide = DivideSurface(Surface=srf, UCount=Slider(27, range=0..100), VCount=Slider(86, range=0..100))  # -> Points, Normals, Parameters
division = Division(A=number_slider_3, B=number_slider)
X = UnitX(Factor=number_slider_3)
series = Series(Start=0, Step=division, Count=number_slider)
image = ImageSampler(
    sdivide.Parameters,
    FilePath="C:\Users\Ariga-GO\Desktop\images.jpg",
    Filter="Value",
    Interpolate=False,
    Umax=150,
    Umin=1,
    Vmax=150,
    Vmin=1,
    Wrap=1)
move = Move(Geometry=pt, Motion=X)  # -> Geometry, Transform
Y = UnitY(Factor=series)
ln = Line(StartPoint=move.Geometry, EndPoint=pt)
move_2 = Move(Geometry=ln, Motion=Y)  # -> Geometry, Transform
multiplication = Multiplication(A=image, B=number_slider_2)
subtraction = Subtraction(A=number_slider_2, B=multiplication)
X_2 = UnitX(Factor=subtraction)
move_3 = Move(Geometry=sdivide.Points, Motion=X_2)  # -> Geometry, Transform
division_2 = Division(A=subtraction, B=Slider(2, range=0..10))
Y_2 = UnitY(Factor=division_2)
X_3 = UnitX(Factor=division_2)
ln_2 = Line(StartPoint=sdivide.Points, EndPoint=move_3.Geometry)
Y_3 = UnitY(Factor=subtraction)
multiplication_2 = Multiplication(A=X_3, B="-1")
move_4 = Move(Geometry=ln_2, Motion=multiplication_2)  # -> Geometry, Transform
line = Line(move_4.Geometry)
shift = ShiftList(List=move_4.Geometry, Shift=1, Wrap=True)
edgesrf = EdgeSurface(CurveA=move_4.Geometry, CurveB=shift)
geo = Geometry(edgesrf)
